# Dynamo graph export_to_excel_bimorph.dyn (Dynamo 2.0.1.5055)

file_path = Filename(".\Takeoff_Dyn.xlsx")
string = StringInput("Columns")
code_block = CodeBlock { 0; }
views = Views(index=162)
getData = Revit.Schedule.GetData(scheduleView=views)
boolean = BoolSelector(true)
exportExcel = Data.ExportExcel(filePath=file_path, sheetName=string, startRow=code_block, startCol=code_block, data=getData, overWrite=boolean)
