# Dynamo graph export_to_excel_para.dyn "export_to_excel" (Dynamo 2.0.1.5055)

file_path = Filename("G:\IM\10-Projects\16.02-AMF\P6 GUI development\ver2\data\test.xlsx")
string = StringInput("columns")
code_block = CodeBlock { 0; }
categories = Categories(index=496)
all_elements_of_category = ElementsOfCategory(Category=categories)
string_2 = StringInput("element ID")
getParameterValueByName = Element.GetParameterValueByName(element=all_elements_of_category, parameterName=string_2)
string_3 = StringInput("Family")
getParameterValueByName_2 = Element.GetParameterValueByName(element=all_elements_of_category, parameterName=string_3)
string_4 = StringInput("Type")
getParameterValueByName_3 = Element.GetParameterValueByName(element=all_elements_of_category, parameterName=string_4)
string_5 = StringInput("Material: Name")
getParameterValueByName_4 = Element.GetParameterValueByName(element=all_elements_of_category, parameterName=string_5)
string_6 = StringInput("Material: Volume")
getParameterValueByName_5 = Element.GetParameterValueByName(element=all_elements_of_category, parameterName=string_6)
string_7 = StringInput("Length")
getParameterValueByName_6 = Element.GetParameterValueByName(element=all_elements_of_category, parameterName=string_7)
string_8 = StringInput("load-bearing capacity")
getParameterValueByName_7 = Element.GetParameterValueByName(element=all_elements_of_category, parameterName=string_8)
string_9 = StringInput("Base Level")
getParameterValueByName_8 = Element.GetParameterValueByName(element=all_elements_of_category, parameterName=string_9)
string_10 = StringInput("Column Location Mark")
getParameterValueByName_9 = Element.GetParameterValueByName(element=all_elements_of_category, parameterName=string_10)
string_11 = StringInput("Count")
getParameterValueByName_10 = Element.GetParameterValueByName(element=all_elements_of_category, parameterName=string_11)
string_12 = StringInput("task ID")
getParameterValueByName_11 = Element.GetParameterValueByName(element=all_elements_of_category, parameterName=string_12)
string_13 = StringInput("order ID")
getParameterValueByName_12 = Element.GetParameterValueByName(element=all_elements_of_category, parameterName=string_13)
string_14 = StringInput("RFID")
getParameterValueByName_13 = Element.GetParameterValueByName(element=all_elements_of_category, parameterName=string_14)
list_create = List.Create(item0=getParameterValueByName, item1=getParameterValueByName_2, item2=getParameterValueByName_3, item3=getParameterValueByName_4, item4=getParameterValueByName_5, item5=getParameterValueByName_6, item6=getParameterValueByName_7, item7=getParameterValueByName_8, item8=getParameterValueByName_9, item9=getParameterValueByName_10, item10=getParameterValueByName_11, item11=getParameterValueByName_12, item12=getParameterValueByName_13)
transpose = List.Transpose(lists=list_create)
boolean = BoolSelector(true)
exportExcel = Data.ExportExcel(filePath=file_path, sheetName=string, startRow=code_block, startCol=code_block, data=transpose, overWrite=boolean)
