# Dynamo graph import_excel_para.dyn (Dynamo 2.0.1.5055)

categories = Categories(index=496)  # graph input
all_elements_of_category = ElementsOfCategory(Category=categories)
string = StringInput("task ID")  # graph input
file_path = Filename(".\Takeoff.xlsx")  # graph input
fromPath = FileObject(path=file_path)  # "File.FromPath"
string_2 = StringInput("Columns")  # graph input
importExcel = Data.ImportExcel(file=fromPath, sheetName=string_2)
number = DoubleInput(1)  # graph input
dropItems = List.DropItems(list=importExcel, amount=number)
transpose = List.Transpose(lists=dropItems)
code_block = CodeBlock { 10; }
getItemAtIndex = List.GetItemAtIndex(list=transpose, index=code_block)
string_from_object = FromObject(obj=getItemAtIndex)
setParameterByName = Element.SetParameterByName(element=all_elements_of_category, parameterName=string, value=string_from_object)
string_3 = StringInput("order ID")  # graph input
code_block_2 = CodeBlock { 11; }
getItemAtIndex_2 = List.GetItemAtIndex(list=transpose, index=code_block_2)
string_from_object_2 = FromObject(obj=getItemAtIndex_2)
setParameterByName_2 = Element.SetParameterByName(element=all_elements_of_category, parameterName=string_3, value=string_from_object_2)
string_4 = StringInput("RFID")  # graph input
code_block_3 = CodeBlock { 12; }
getItemAtIndex_3 = List.GetItemAtIndex(list=transpose, index=code_block_3)
string_from_object_3 = FromObject(obj=getItemAtIndex_3)
setParameterByName_3 = Element.SetParameterByName(element=all_elements_of_category, parameterName=string_4, value=string_from_object_3)
string_5 = StringInput("load-bearing capacity")  # graph input
code_block_4 = CodeBlock { 6; }
getItemAtIndex_4 = List.GetItemAtIndex(list=transpose, index=code_block_4)
setParameterByName_4 = Element.SetParameterByName(element=all_elements_of_category, parameterName=string_5, value=getItemAtIndex_4)
